# Dynamo graph Training Model.dyn (Dynamo 1.3.2.2480)

# group: DUCTS
categories = Categories("DuctCurves")
all_elements_of_category = ElementsOfCategory(categories)
watch = Watch(all_elements_of_category)
parameters = Element.Parameters(all_elements_of_category)
watch_2 = Watch(parameters)

# group: PIPES
categories_2 = Categories("PipeCurves")
all_elements_of_category_2 = ElementsOfCategory(categories_2)
watch_3 = Watch(all_elements_of_category_2)
parameters_2 = Element.Parameters(all_elements_of_category_2)
watch_4 = Watch(parameters_2)

# group: WALLS
categories_3 = Categories("Walls")
all_elements_of_category_3 = ElementsOfCategory(categories_3)
watch_5 = Watch(all_elements_of_category_3)
parameters_3 = Element.Parameters(all_elements_of_category_3)
watch_6 = Watch(parameters_3)

# group: STRUCTURAL COLUMNS
categories_4 = Categories("StructuralColumns")
all_elements_of_category_4 = ElementsOfCategory(categories_4)
watch_7 = Watch(all_elements_of_category_4)
parameters_4 = Element.Parameters(all_elements_of_category_4)
watch_8 = Watch(parameters_4)

# group: FLOORS
categories_5 = Categories("Floors")
all_elements_of_category_5 = ElementsOfCategory(categories_5)
watch_9 = Watch(all_elements_of_category_5)
parameters_5 = Element.Parameters(all_elements_of_category_5)
watch_10 = Watch(parameters_5)

# group: CABLE TRAYS
categories_6 = Categories("CableTray")
all_elements_of_category_6 = ElementsOfCategory(categories_6)
watch_11 = Watch(all_elements_of_category_6)
parameters_6 = Element.Parameters(all_elements_of_category_6)
watch_12 = Watch(parameters_6)

# group: ELECTRICAL EQUIPMENT
categories_7 = Categories("ElectricalEquipment")
all_elements_of_category_7 = ElementsOfCategory(categories_7)
watch_13 = Watch(all_elements_of_category_7)
parameters_7 = Element.Parameters(all_elements_of_category_7)
watch_14 = Watch(parameters_7)

# group: DUCT FITTINGS
categories_8 = Categories("DuctFitting")
all_elements_of_category_8 = ElementsOfCategory(categories_8)
watch_15 = Watch(all_elements_of_category_8)
parameters_8 = Element.Parameters(all_elements_of_category_8)
watch_16 = Watch(parameters_8)

# group: WIRES
categories_9 = Categories("Wire")
all_elements_of_category_9 = ElementsOfCategory(categories_9)
watch_17 = Watch(all_elements_of_category_9)
parameters_9 = Element.Parameters(all_elements_of_category_9)
watch_18 = Watch(parameters_9)

# group: STRUCTURAL FRAMING
categories_10 = Categories("StructuralFraming")
all_elements_of_category_10 = ElementsOfCategory(categories_10)
watch_19 = Watch(all_elements_of_category_10)
parameters_10 = Element.Parameters(all_elements_of_category_10)
watch_20 = Watch(parameters_10)

# group: STRUCTURAL FOUNDATIONS
categories_11 = Categories("StructuralFoundation")
all_elements_of_category_11 = ElementsOfCategory(categories_11)
watch_21 = Watch(all_elements_of_category_11)
parameters_11 = Element.Parameters(all_elements_of_category_11)
watch_22 = Watch(parameters_11)

# group: FILTER BY BASE CONSTRAINT LEVEL 0
code_block = CodeBlock { "Base Constraint"; }
getParameterValueByName = Element.GetParameterValueByName(element=all_elements_of_category_3, parameterName=code_block)  # frozen
name = Level.Name(getParameterValueByName)
levels = Levels("LEVEL 0")
name_2 = Level.Name(levels)
filterByString = Custom[List.FilterByString](list=name, String=name_2)  # Filter a list by a string match
filterByBoolMask = List.FilterByBoolMask(list=all_elements_of_category_3, mask=filterByString.Bool)  # frozen
geometry = Element.Geometry(filterByBoolMask.in)
watch_23 = Watch(filterByBoolMask.in)

joinGeometry = Custom[Element.JoinGeometry]()  # Joins two model elements (if possible). Only works inside the project environment.; unwired: element1, element2
filterByBaseConstraint = Custom[FilterByBaseConstraint](element=all_elements_of_category_3, list=all_elements_of_category_3)  # Filters a list of walls by base constraint level
watch_24 = Watch(filterByBaseConstraint)
solids = Element.Solids(filterByBaseConstraint)
